# Grasshopper definition ex01-01_alt.ghx (Grasshopper 1.0.7)

gi_string = GetString("Hello", AtLeast=1, AtMost=2147483647)
go_string = GetString(gi_string, AtLeast=1, AtMost=2147483647)
panel = Panel(go_string)
