# Grasshopper definition ex01-02.ghx (Grasshopper 1.0.7)

# ---- group: RH_IN:gi_num2
num = Number(Slider(3, range=0..10))

# ---- group: RH_IN:gi_num1
num_2 = Number(Slider(2, range=0..10))

# ----
multiplication = Multiplication(A=num_2, B=num)

# ---- group: RH_OUT:go_mult
num_3 = Number(multiplication)

# ----
viewer = ParamViewer(num_3)
