# Grasshopper definition ex02.ghx (Grasshopper 1.0.7)

# ---- group: RH_IN:gi_num2
num = Number(Slider(3, range=0..10))

# ---- group: RH_IN:gi_num1
num_2 = Number(Slider(2, range=0..10))

# ----
multiplication = Multiplication(A=num_2, B=num)
interrupt = BooleanToggle(True)
series = Series(Start=0, Step=1, Count=10)

# ---- group: RH_OUT:go_mult
num_3 = Number(multiplication)

# ----
filter = StreamFilter(Gate=interrupt, Stream0=num_3, Stream1=series)
pt = ConstructPoint(XCoordinate=0, YCoordinate=0, ZCoordinate=0)

# ---- group: RH_IN:gi_mult
num_4 = Number(filter)

# ---- group: RH_IN:gi_pt
geo = Geometry(pt)

# ----
rectangle = Rectangle(Plane=geo, XSize=num_4, YSize=num_4, Radius=0)  # -> Rectangle, Length
area = Area(Geometry=rectangle.Rectangle)  # -> Area, Centroid

# ---- group: RH_OUT:go_area
num_5 = Number(area.Area)

# ----
viewer = ParamViewer(num_5)
panel = Panel(num_5)
