# Grasshopper definition ex02_alt.ghx (Grasshopper 1.0.7)

gi_num1 = GetNumber(Slider(2, range=0..10), AtLeast=1, AtMost=2147483647, Maximum=1.797693135e+308, Minimum=-1.797693135e+308)
gi_nub2 = GetNumber(Slider(3, range=0..10), AtLeast=1, AtMost=2147483647, Maximum=1.797693135e+308, Minimum=-1.797693135e+308)
multiplication = Multiplication(A=gi_num1, B=gi_nub2)
pt = ConstructPoint(XCoordinate=0, YCoordinate=0, ZCoordinate=0)
gi_pt = GetPoint(pt, AtLeast=1, AtMost=2147483647, Realtime=True)
go_mult = GetNumber(multiplication, AtLeast=1, AtMost=2147483647, Maximum=1.797693135e+308, Minimum=-1.797693135e+308)
gi_mult = GetNumber(go_mult, AtLeast=1, AtMost=2147483647, Maximum=1.797693135e+308, Minimum=-1.797693135e+308)
rectangle = Rectangle(Plane=gi_pt, XSize=gi_mult, YSize=gi_mult, Radius=0)  # -> Rectangle, Length
go_rec = GetGeometry(rectangle.Rectangle, AtLeast=1, AtMost=2147483647, Filter=1074004029)
viewer = ParamViewer(go_rec)
gi_rec = GetGeometry(go_rec, AtLeast=1, AtMost=2147483647, Filter=1074004029)
area = Area(Geometry=gi_rec)  # -> Area, Centroid
go_area = GetNumber(area.Area, AtLeast=1, AtMost=2147483647, Maximum=1.797693135e+308, Minimum=-1.797693135e+308)
viewer_2 = ParamViewer(go_area)
panel = Panel(go_area)
