# Grasshopper definition ex04-00.ghx (Grasshopper 1.0.7)
# plug-ins: MeshEdit Components, MetaHopper

groups = GetGroups()  # -> Groups, GroupStyles, Nickname, Color

split = TextSplit(Text=groups.Nickname, Separators=":")
mindex = MemberIndex(Set=split, Member="RH_IN")  # -> Index, Count
lng = ListLength(List=mindex.Index)  # -> flatten(Length)
dispatch = Dispatch(List=groups.Nickname, DispatchPattern=lng)  # -> ListA, ListB

# ---- group: RH_IN:txt
txt = Text("True")

# ---- group: RH_OUT:txt
txt_2 = Text(txt)

# ----
series = Series(Start=0, Step=1, Count=10)
panel = Panel(txt_2)

# ---- group: RH_IN:numb
num = Number(Slider(1.5, range=0..10))

# ---- group: RH_IN:bool
bool = Boolean(txt_2)

# ---- group: RH_OUT:numb
num_2 = Number(num)

# ---- group: RH_OUT:bool
bool_2 = Boolean(bool)

# ----
filter = StreamFilter(Gate=bool_2, Stream0=Toggle(True), Stream1=Toggle(False))
filter_2 = StreamFilter(Gate=filter, Stream0=Slider(0, range=0..10), Stream1=num_2)

# ---- group: RH_OUT:go_q_inputs
txt_3 = Text(dispatch.ListA)

# ----
number_slider = Slider(5, range=0..10)
pt = ConstructPoint(XCoordinate=filter_2, YCoordinate=filter_2, ZCoordinate=filter_2)
panel_2 = Panel(dispatch.ListB)
panel_3 = Panel(txt_3)

# ---- group: RH_OUT:pt
pt_2 = Point(pt)

# ---- group: RH_IN:pt
pt_3 = Point(pt_2)

# ----
rectangle = Rectangle(Plane=pt_3, XSize=number_slider, YSize=number_slider, Radius=0)  # -> Rectangle, Length
polygon = Polygon(Plane=pt_3, Radius=number_slider, Segments=Slider(6, range=0..10), FilletRadius=0)  # -> Polygon, Length
cir = Circle(Plane=pt_3, Radius=number_slider)

# ---- group: RH_OUT:rec
crv = Curve(rectangle.Rectangle)

# ---- group: RH_OUT:circle
circle = Circle(cir)

# ---- group: RH_OUT:polygon
crv_2 = Curve(polygon.Polygon)

# ----
explode = Explode(Curve=crv, Recursive=True)  # -> Segments, Vertices
intcrv = Interpolate(Vertices=explode.Vertices, Degree=3, Periodic=Toggle(True), KnotStyle=1)  # -> Curve, Length, Domain

# ---- group: RH_IN:any_crv
crv_3 = Curve(crv)

# ---- group: RH_OUT:interpt_crv
crv_4 = Curve(intcrv.Curve)

# ----
boundary = BoundarySurfaces(Edges=crv_3)

# ---- group: RH_OUT:srf
srf = Surface(boundary)

# ---- group: RH_IN:srf
srf_2 = Surface(srf)

# ----
Z = UnitZ(Factor=Slider(5, range=0..10))
extr = Extrude(Base=srf_2, Direction=Z)

# ---- group: RH_OUT:brep
brep = Brep(extr)

# ---- group: RH_IN:brep
brep_2 = Brep(brep)

# ----
jagged = SettingsSpeed()
volume = Volume(Geometry=brep_2)  # -> Volume, Centroid
mesh = MeshBrep(Brep=brep_2, Settings=jagged)

# ---- group: RH_OUT:mesh
mesh_2 = Mesh(mesh)

# ---- group: RH_OUT:brep_vol
num_3 = Number(volume.Volume)

# ---- group: RH_OUT:brep_vcpt
pt_4 = Point(volume.Centroid)

# ---- group: RH_IN:mesh
mesh_3 = Mesh(mesh_2)

# ----
volume_2 = MeshVolume(Mesh=mesh_3)  # -> Volume, Centroid

# ---- group: RH_OUT:mesh_vol
num_4 = Number(volume_2.Volume)

# ---- group: RH_OUT:mesh_vcpt
pt_5 = Point(volume_2.Centroid)
