# Grasshopper definition ex04-01-string.ghx (Grasshopper 1.0.7)

# ---- group: RH_IN:string
txt = Text("Hello")

# ----
get_string = GetString(AtLeast=1, AtMost=2147483647)

# ---- group: RH_OUT:string
txt_2 = Text(txt)

# ----
panel = Panel(txt_2)
