# Grasshopper definition ex04-01-stringB.ghx (Grasshopper 1.0.7)

rh_in_string = GetString("[1,2,3]", AtLeast=1, AtMost=2147483647, Prompt="This is List")
rh_out_string = GetString(rh_in_string, AtLeast=1, AtMost=2147483647, Prompt="This is List")
panel = Panel(rh_out_string)
