# Grasshopper definition ex04-02-float.ghx (Grasshopper 1.0.7)

# ---- group: RH_IN:float
num = Number(Slider(0.5, range=0..1))

# ---- group: RH_OUT:float
num_2 = Number(num)

# ----
panel = Panel(num_2)
