# Grasshopper definition ex04-02-int.ghx (Grasshopper 1.0.7)

# ---- group: RH_IN:integer
int = Integer(Slider(5, range=0..10))

# ---- group: RH_OUT:integer
int_2 = Integer(int)

# ----
panel = Panel(int_2)
