# Grasshopper definition ex04-03-boolan.ghx (Grasshopper 1.0.7)

# ---- group: RH_IN:boolean
bool = Boolean(Toggle(True))

# ---- group: RH_OUT:boolean
bool_2 = Boolean(bool)

# ----
filter = StreamFilter(Gate=bool_2, Stream0=Slider(0.5, range=0..1), Stream1=Slider(1.5, range=0..10))

# ---- group: RH_OUT:numb
num = Number(filter)

# ----
panel = Panel(num)
