# Grasshopper definition ex04-04-interval.ghx (Grasshopper 1.0.7)

# ---- group: RH_IN:count
num = Number(Slider(15, range=0..100))

# ---- group: RH_IN:numb1
num_2 = Number(Slider(0, range=0..1))

# ---- group: RH_IN:numb2
num_3 = Number(Slider(1, range=0..1))

# ----
series = Series(Start=0, Step=1, Count=num)
dom = ConstructDomain(DomainStart=num_2, DomainEnd=num_3)

# ---- group: RH_OUT:interv
domain = Domain(dom)

# ----
bnd = Bounds(Numbers=series)

# ---- group: RH_IN:interv
domain_2 = Domain(domain)

# ----
remap = RemapNumbers(Value=series, Source=bnd, Target=domain_2)  # -> Mapped, Clipped

# ---- group: RH_OUT:numb
num_4 = Number(remap.Mapped)

# ----
panel = Panel(num_4)
