# Grasshopper definition ex04-05-point.ghx (Grasshopper 1.0.7)

pt = ConstructPoint(XCoordinate=0, YCoordinate=0, ZCoordinate=0)

# ---- group: RH_IN:gi_pt
pt_2 = Point(pt)

# ---- group: RH_OUT:go_pt
pt_3 = Point(pt_2)

# ----
pdecon = Deconstruct(Point=pt_3)  # -> XComponent, YComponent, ZComponent

# ---- group: RH_OUT:go_pt_y
num = Number(pdecon.YComponent)

# ---- group: RH_OUT:go_pt_z
num_2 = Number(pdecon.ZComponent)

# ---- group: RH_OUT:go_pt_x
num_3 = Number(pdecon.XComponent)
