# Grasshopper definition ex04-07-plane.ghx (Grasshopper 1.0.7)

rad = Radians(Degrees=Slider(0, range=0..360))

# ---- group: RH_IN:pl_norm
num = Number(Slider(180, range=0..360))

# ----
rad_2 = Radians(Degrees=num)
pt = PointPolar(BasePlane=PlaneXY(0, 0, 0), XYAngle=rad, ZAngle=rad_2, Offset=1)
pt_2 = Point(Point(0, 0, 0))
vec2pt = Vector2Pt(PointA=pt_2, PointB=pt, Unitize=False)  # -> Vector, Length
pl = PlaneNormal(Origin=pt_2, ZAxis=vec2pt.Vector)

# ---- group: RH_OUT:pln
pln = Plane(pl)

# ---- group: RH_IN:pln
pln_2 = Plane(pln)

# ----
cir = Circle(Plane=pln_2, Radius=Slider(5, range=0..10))
project = Project(Geometry=cir, Plane=PlaneXY(0, 0, 0))  # -> Geometry, Transform
area = Area(Geometry=project.Geometry)  # -> Area, Centroid

# ---- group: RH_OUT:prj_area
num_2 = Number(area.Area)

# ----
panel = Panel(num_2)
