# Grasshopper definition ex04-08-line.ghx (Grasshopper 1.0.7)

pt = ConstructPoint(XCoordinate=0, YCoordinate=0, ZCoordinate=0)
pt_2 = ConstructPoint(XCoordinate=Slider(1.5, range=0..10), YCoordinate=0, ZCoordinate=0)
ln = Line(StartPoint=pt, EndPoint=pt_2)

# ---- group: RH_OUT:line
line = Line(ln)

# ---- group: RH_IN:line
line_2 = Line(line)

# ----
len = Length(Curve=line_2)

# ---- group: RH_OUT:line_len
num = Number(len)

# ----
panel = Panel(num)
