# Grasshopper definition ex04-09-polyline.ghx (Grasshopper 1.0.7)

dom = ConstructDomain(DomainStart=0, DomainEnd=Slider(360, range=0..1000))
range = Range(Domain=dom, Steps=Slider(15, range=0..100))
rad = Radians(Degrees=range)
sin = Sine(Value=rad)
pt = ConstructPoint(XCoordinate=rad, YCoordinate=sin, ZCoordinate=0)
pline = PolyLine(Vertices=pt, Closed=False)

# ---- group: RH_OUT:pline
crv = Curve(pline)

# ---- group: RH_IN:pline
crv_2 = Curve(crv)

# ----
divide = DivideCurve(Curve=crv_2, Count=Slider(5, range=0..10), Kinks=False)  # -> Points, Tangents, Parameters

# ---- group: RH_OUT:pline_divpt
pt_2 = Point(divide.Points)
