# Grasshopper definition ex04-10-circle.ghx (Grasshopper 1.0.7)

pt = ConstructPoint(XCoordinate=0, YCoordinate=0, ZCoordinate=0)

# ---- group: RH_IN:circle_center
pt_2 = Point(pt)

# ----
xy = XYPlane(Origin=pt_2)

# ---- group: RH_IN:circle_radius
num = Number(Slider(15, range=0..100))

# ----
cir = Circle(Plane=xy, Radius=num)

# ---- group: RH_OUT:circle
crv = Curve(cir)

# ----
multiplication = Multiplication(A=num, B=Slider(2, range=0..10))

# ---- group: RH_IN:any_curve
crv_2 = Curve(crv)

# ----
area = Area(Geometry=crv_2)  # -> Area, Centroid

# ---- group: RH_OUT:curve_area
num_2 = Number(area.Area)

# ---- group: RH_IN:curve_area
num_3 = Number(num_2)

# ----
division = Division(A=num_3, B=multiplication)
divide = DivideCurve(Curve=crv_2, Count=division, Kinks=False)  # -> Points, Tangents, Parameters

# ---- group: RH_OUT:curve_div_pt
pt_3 = Point(divide.Points)

# ----
lng = ListLength(List=pt_3)

# ---- group: RH_OUT:curve_div_cont
num_4 = Number(lng)
