# Grasshopper definition ex04-12-polycurve.ghx (Grasshopper 1.0.7)
# plug-ins: Human

dom = ConstructDomain(DomainStart=0, DomainEnd=Slider(360, range=0..1000))
range = Range(Domain=dom, Steps=Slider(38, range=0..100))
rad = Radians(Degrees=range)
sin = Sine(Value=rad)
pt = ConstructPoint(XCoordinate=rad, YCoordinate=sin, ZCoordinate=0)
number_slider = Slider(5, range=0..100)
pline = PolyLine(Vertices=pt, Closed=False)
explode = Explode(Curve=pline, Recursive=True)  # -> Segments, Vertices
dom_2 = ConstructDomain(DomainStart=0, DomainEnd=Slider(180, range=0..1000))
rad_2 = Radians(Degrees=dom_2)
divide = DivideCurve(Curve=explode.Segments, Count=number_slider, Kinks=False)  # -> Points, Tangents, Parameters
range_2 = Range(Domain=rad_2, Steps=number_slider)
rad_3 = Radians(Degrees=Slider(90, range=0..100))
Z = UnitZ(Factor=1)
sin_2 = Sine(Value=range_2)
vrot = Rotate(Vector=divide.Tangents, Axis=Z, Angle=rad_3)
bnd = Bounds(Numbers=sin_2)
dom_3 = ConstructDomain(DomainStart=0, DomainEnd=Slider(0.27, range=0..1))
remap = RemapNumbers(Value=sin_2, Source=bnd, Target=dom_3)  # -> Mapped, Clipped
amp = Amplitude(Vector=vrot, Amplitude=remap.Mapped)
move = Move(Geometry=divide.Points, Motion=amp)  # -> Geometry, Transform
nurbs = NurbsCurve(Vertices=move.Geometry, Degree=3, Periodic=False)  # -> flatten(Curve), Length, Domain
join = JoinCurves(Curves=nurbs.Curve, Preserve=False)

# ---- group: RH_OUT:plcrv
crv = Curve(join)

# ---- group: RH_IN:plcrv
crv_2 = Curve(crv)

# ----
divide_2 = DivideCurve(Curve=crv_2, Count=Slider(10, range=0..10), Kinks=False)  # -> Points, Tangents, Parameters

# ---- group: RH_OUT:plcrv_divpt
pt_2 = Point(divide_2.Points)

# ----
previewlw = CustomPreviewLineweights(Geometry=pt_2, Shader=ColourSwatch(SwatchColor=RGB(255, 0, 0)), Absolute=False)
previewlw_2 = CustomPreviewLineweights(Geometry=crv_2, Shader=ColourSwatch(SwatchColor=RGB(0, 174, 255)), Absolute=False)
