# Grasshopper definition ex04-13-surface.ghx (Grasshopper 1.0.7)

# ---- group: RH_IN:circle_distance
num = Number(Slider(4, range=0..10))

# ---- group: RH_IN:circle_radius
num_2 = Number(Slider(0.7, range=0..2))

# ----
series = Series(Start=0, Step=num, Count=10)
pt = ConstructPoint(XCoordinate=series, YCoordinate=0, ZCoordinate=0)
multiplication = Multiplication(A=num, B=num_2)
cir = Circle(Plane=pt, Radius=multiplication)

# ---- group: RH_OUT:circles
crv = Curve(cir)

# ---- group: RH_IN:any_curves
crv_2 = Curve(crv)

# ----
runion = RegionUnion(Curves=flatten(crv_2))

# ---- group: RH_OUT:curves_merge
crv_3 = Curve(runion)

# ----
boundary = BoundarySurfaces(Edges=crv_3)

# ---- group: RH_OUT:surface
srf = Surface(boundary)
