# Grasshopper definition ex04-14-brep.ghx (Grasshopper 1.0.7)

number_slider = Slider(5, range=0..10)
rectangle = Rectangle(Plane=PlaneXY(0, 0, 0), XSize=number_slider, YSize=number_slider, Radius=0)  # -> Rectangle, Length
polygon = Polygon(Plane=PlaneXY(0, 0, 0), Radius=number_slider, Segments=Slider(6, range=0..10), FilletRadius=0)  # -> Polygon, Length
cir = Circle(Plane=PlaneXY(0, 0, 0), Radius=number_slider)

# ---- group: RH_OUT:circle
circle = Circle(cir)

# ---- group: RH_OUT:polygon
crv = Curve(polygon.Polygon)

# ----
explode = Explode(Curve=rectangle.Rectangle, Recursive=True)  # -> Segments, Vertices

# ---- group: RH_OUT:rec
crv_2 = Curve(rectangle.Rectangle)

# ----
intcrv = Interpolate(Vertices=explode.Vertices, Degree=3, Periodic=Toggle(True), KnotStyle=1)  # -> Curve, Length, Domain

# ---- group: RH_IN:any_crv
crv_3 = Curve(crv_2)

# ---- group: RH_OUT:interpt_crv
crv_4 = Curve(intcrv.Curve)

# ----
boundary = BoundarySurfaces(Edges=crv_3)

# ---- group: RH_OUT:srf
srf = Surface(boundary)

# ---- group: RH_IN:srf
srf_2 = Surface(srf)

# ----
Z = UnitZ(Factor=Slider(5, range=0..10))
extr = Extrude(Base=srf_2, Direction=Z)

# ---- group: RH_OUT:brep
brep = Brep(extr)
