# Grasshopper definition ex04-15-mesh-export.ghx (Grasshopper 1.0.7)
# plug-ins: MeshEdit Components

cell_radius = Slider(10, range=0..10)
branch_length = Slider(10, range=0..10)
sph = Sphere(Base=PlaneXY(0, 0, 0), Radius=cell_radius)

# ---- group: RH_IN:mesh_res
int = Integer(Slider(25, range=0..100))

# ---- group: RH_IN:mesh_param
num = Number(branch_length)

# ----
popgeo = PopulateGeometry(Geometry=sph, Count=int, Seed=1)
facet = FacetDome(Points=popgeo, Radius=cell_radius)  # -> Pattern, Dome
pt = ConstructPoint(XCoordinate="0.5", YCoordinate="0.5", ZCoordinate=0)
boundary = BoundarySurfaces(Edges=facet.Pattern)
evalsrf = EvaluateSurface(Surface=reparameterize(boundary), Point=pt)  # -> Point, Normal, UDirection, VDirection, Frame
deplane = DeconstructPlane(Plane=evalsrf.Frame)  # -> Origin, XAxis, YAxis, ZAxis
amp = Amplitude(Vector=deplane.ZAxis, Amplitude=num)
move = Move(Geometry=facet.Pattern, Motion=amp)  # -> Geometry, Transform
explode = Explode(Curve=facet.Pattern, Recursive=True)  # -> graft(Segments), Vertices
explode_2 = Explode(Curve=move.Geometry, Recursive=True)  # -> graft(Segments), Vertices
cp = ControlPoints(Curve=move.Geometry)  # -> Points, Weights, Knots
shift = ShiftList(List=cp.Points, Shift=1, Wrap=invert(True))
end = EndPoints(Curve=explode.Segments)  # -> Start, End
end_2 = EndPoints(Curve=explode_2.Segments)  # -> Start, End
del = DelaunayMesh(Points=shift, Plane=PlaneXY(0, 0, 0))
merge = Merge(Data1=end.Start, Data2=end_2.Start, Data3=end_2.End, Data4=end.End)
quad = Quadrangulate(Mesh=del, Angle=Slider(1, range=0..1), Ratio=Slider(0, range=0..1))  # -> flatten(Mesh), Count
conmesh = ConstructMesh(Vertices=merge, Faces={A=0, B=1, C=2, D=3})
mjoin = MeshJoin(Meshes=flatten(conmesh))
alignvert = AlignVertices(Mesh=mjoin, Tolerance=0.1)  # -> Result, Count
mesh = Mesh(quad.Mesh)
weld = WeldMesh(Mesh=alignvert.Result, Angle=3.141592654)
mjoin_2 = MeshJoin(Meshes=flatten([weld, mesh]))
alignvert_2 = AlignVertices(Mesh=mjoin_2, Tolerance=0.1)  # -> Result, Count
weld_2 = WeldMesh(Mesh=alignvert_2.Result, Angle=3.141592654)
meshsubd = MeshFromSubD(SubD=weld_2, Density=2)

popgeo_2 = PopulateGeometry(Geometry=meshsubd, Count=Slider(15, range=0..100), Seed=1)
meshcp = MeshClosestPoint(Point=popgeo_2, Mesh=meshsubd)  # -> Point, Index, Parameter

volume = MeshVolume(Mesh=meshsubd)  # -> Volume, Centroid
dist = Distance(PointA=popgeo_2, PointB=volume.Centroid)
avr = Average(Input=dist)

flipm = FlipMesh(Mesh=meshsubd, VertexNormals=True, FaceNormals=True, FaceOrientation=True)
meval = MeshEval(Mesh=flipm, Parameter=meshcp.Parameter)  # -> Point, Normal, Colour
meval_2 = MeshEval(Mesh=meshsubd, Parameter=meshcp.Parameter)  # -> Point, Normal, Colour
multiplication = Multiplication(A=avr, B=Slider(0.5, range=0..2))

amp_2 = Amplitude(Vector=meval.Normal, Amplitude=multiplication)
move_2 = Move(Geometry=meval.Point, Motion=amp_2)  # -> Geometry, Transform
minc = MeshInclusion(Mesh=meshsubd, Point=move_2.Geometry, Strict=False)
ma = MassAddition(Input=minc)  # -> Result, PartialResults

amp_3 = Amplitude(Vector=meval_2.Normal, Amplitude=multiplication)
move_3 = Move(Geometry=meval_2.Point, Motion=amp_3)  # -> Geometry, Transform
minc_2 = MeshInclusion(Mesh=meshsubd, Point=move_3.Geometry, Strict=False)
ma_2 = MassAddition(Input=minc_2)  # -> Result, PartialResults

smaller = SmallerThan(FirstNumber=ma.Result, SecondNumber=ma_2.Result)  # -> SmallerThan, OrEqualTo
filter = StreamFilter(Gate=smaller.SmallerThan, Stream0=meshsubd, Stream1=flipm)
mesh_2 = Mesh(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)
triangulate = BooleanToggle(True)
tri = Triangulate(Mesh=filter)  # -> Mesh, Count

# ---- group: RH_IN:mesh_tri
bool = Boolean(triangulate)

# ----
filter_2 = StreamFilter(Gate=bool, Stream0=filter, Stream1=tri.Mesh)

# ---- group: RH_OUT:mesh
mesh_3 = Mesh(filter_2)

# ---- group: RH_IN:mesh
mesh_4 = Mesh(mesh_3)

# ----
demesh = DeconstructMesh(Mesh=mesh_4)  # -> Vertices, Faces, Colours, Normals

# ---- group: RH_OUT:mesh_face
txt = Text(demesh.Faces)

# ---- group: RH_OUT:mesh_vertex
pt_2 = Point(demesh.Vertices)

# ----
number_slider = Slider(0, range=0..100)
chars = Characters(Text=txt)  # -> Result, Unicode
item = ListItem(List=chars.Result, Index=number_slider, Wrap=True)  # -> flatten(Item)
cull_i = CullIndex(List=chars.Result, Indices=number_slider, Wrap=True)
join = TextJoin(Text=cull_i)  # -> flatten(Result)

rep = ReplaceText(Text=pt_2, Find="{", RecursiveReplace=False)
rep_2 = ReplaceText(Text=rep, Find="}", RecursiveReplace=False)

rep_3 = ReplaceText(Text=join, Find="{", RecursiveReplace=False)
rep_4 = ReplaceText(Text=rep_3, Find="}", RecursiveReplace=False)

rep_5 = ReplaceText(Text=item, Find="T", Replace="triangle", RecursiveReplace=False)

rep_6 = ReplaceText(Text=rep_4, Find=";", Replace=",", RecursiveReplace=False)

concat = Concatenate(FragmentA="[", FragmentC=rep_2, FragmentB="]")

rep_7 = ReplaceText(Text=rep_5, Find="Q", Replace="quad", RecursiveReplace=False)

concat_2 = Concatenate(FragmentA="[", FragmentC=rep_6, FragmentB="]")  # -> flatten(Result)

# ---- group: RH_OUT:mesh_vertex_list
txt_2 = Text(concat)

# ---- group: RH_OUT:mesh_face_type
txt_3 = Text(rep_7)

# ---- group: RH_OUT:mesh_face_list
txt_4 = Text(concat_2)
