# Grasshopper definition ex04-15-mesh01.ghx (Grasshopper 1.0.7)

# ---- group: RH_IN:box_size
num = Number(Slider(15, range=0..100))

# ----
box = CenterBox(Base=PlaneXY(0, 0, 0), X=num, Y=num, Z=num)

# ---- group: RH_OUT:box
geo = Geometry(box)

# ---- group: RH_IN:mesh_box
geo_2 = Geometry(geo)

# ---- group: RH_IN:mesh_res
int = Integer(Slider(10, range=0..10))

# ----
mbox = MeshBox(Base=geo_2, XCount=int, YCount=int, ZCount=int)
triangulate = BooleanToggle(True)
tri = Triangulate(Mesh=mbox)  # -> Mesh, Count

# ---- group: RH_IN:mesh_tri
bool = Boolean(triangulate)

# ----
filter = StreamFilter(Gate=bool, Stream0=mbox, Stream1=tri.Mesh)

# ---- group: RH_OUT:mesh
geo_3 = Geometry(filter)

# ---- group: RH_IN:mesh
geo_4 = Geometry(geo_3)

# ----
demesh = DeconstructMesh(Mesh=geo_4)  # -> Vertices, Faces, Colours, Normals

# ---- group: RH_OUT:mesh_face
txt = Text(demesh.Faces)

# ----
number_slider = Slider(0, range=0..100)

# ---- group: RH_OUT:mesh_vertex
pt = Point(demesh.Vertices)

# ----
chars = Characters(Text=txt)  # -> Result, Unicode
pdecon = Deconstruct(Point=pt)  # -> XComponent, YComponent, ZComponent
item = ListItem(List=chars.Result, Index=number_slider, Wrap=True)  # -> flatten(Item)
cull_i = CullIndex(List=chars.Result, Indices=number_slider, Wrap=True)

# ---- group: RH_OUT:vertex_Z
num_2 = Number(pdecon.ZComponent)

# ---- group: RH_OUT:vertex_X
num_3 = Number(pdecon.XComponent)

# ---- group: RH_OUT:vertex_Y
num_4 = Number(pdecon.YComponent)

# ----
join = TextJoin(Text=cull_i)  # -> flatten(Result)

rep = ReplaceText(Text=pt, Find="{", RecursiveReplace=False)
rep_2 = ReplaceText(Text=rep, Find="}", RecursiveReplace=False)

rep_3 = ReplaceText(Text=join, Find="{", RecursiveReplace=False)
rep_4 = ReplaceText(Text=rep_3, Find="}", RecursiveReplace=False)

split = TextSplit(Text=rep_4, Separators=";")

join_2 = TextJoin(Text=split, Join=",")

rep_5 = ReplaceText(Text=item, Find="T", Replace="triangle", RecursiveReplace=False)

concat = Concatenate(FragmentA="[", FragmentC=rep_2, FragmentB="]")

concat_2 = Concatenate(FragmentA="[", FragmentC=join_2, FragmentB="]")  # -> flatten(Result)

# ---- group: RH_IN:mesh_module
bool_2 = Boolean(Toggle(True))

# ----
rep_6 = ReplaceText(Text=rep_5, Find="Q", Replace="quad", RecursiveReplace=False)

# ---- group: RH_OUT:mesh_face_list
txt_2 = Text(concat_2)

# ---- group: RH_OUT:mesh_vertex_list
txt_3 = Text(concat)

# ----
filter_2 = StreamFilter(Gate=bool_2, Stream0=item, Stream1=rep_6)

# ---- group: RH_OUT:mesh_face_type
txt_4 = Text(filter_2)

# ----
panel = Panel(txt_3)
panel_2 = Panel(txt_4)
panel_3 = Panel(txt_2)

number_slider_2 = Slider(40, range=0..100)
data = Data(geo_4)
random = Random(Range=Domain(0, 1), Number=number_slider_2, Seed=2)
popgeo = PopulateGeometry(Geometry=data, Count=number_slider_2, Seed=1)
gradient = Gradient(
    LowerLimit=0,
    UpperLimit=1,
    Parameter=random,
    stops=[0: RGB(0, 98, 0), 0.25: RGB(81, 175, 17), 0.5: RGB(159, 198, 146), 0.75: RGB(170, 235, 41), 1: RGB(221, 255, 53)])
mspray = MeshSpray(Mesh=data, Points=popgeo, Colours=gradient, SprayMode=11)
mblur = BlurMesh(Mesh=mspray, Iterations=Slider(1, range=0..10))

panel_4 = Panel(",")  # disabled
join_3 = TextJoin(Text=flatten(txt_2), Join=panel_4)  # disabled

panel_5 = Panel("]")  # disabled
panel_6 = Panel("[")  # disabled
concat_3 = Concatenate(FragmentA=panel_6, FragmentC=join_3, FragmentB=panel_5)  # disabled
