# Grasshopper definition ex04-15-mesh02.ghx (Grasshopper 1.0.7)

# ---- group: RH_IN:sphere_size
num = Number(Slider(15, range=0..100))

# ---- group: RH_IN:mesh_resol
int = Integer(Slider(10, range=0..10))

# ----
msphere = MeshSphere(Base=PlaneXY(0, 0, 0), Radius=num, UCount=int, VCount=int)
triangulate = BooleanToggle(True)
tri = Triangulate(Mesh=msphere)  # -> Mesh, Count

# ---- group: RH_IN:mesh_tri
bool = Boolean(triangulate)

# ----
filter = StreamFilter(Gate=bool, Stream0=msphere, Stream1=tri.Mesh)

# ---- group: RH_IN:mesh
geo = Geometry(filter)

# ---- group: RH_OUT:mesh
geo_2 = Geometry(geo)

# ----
demesh = DeconstructMesh(Mesh=geo_2)  # -> Vertices, Faces, Colours, Normals

# ---- group: RH_OUT:mesh_vertex
pt = Point(demesh.Vertices)

# ----
number_slider = Slider(0, range=0..100)

# ---- group: RH_OUT:mesh_face
txt = Text(demesh.Faces)

# ----
chars = Characters(Text=txt)  # -> Result, Unicode
pdecon = Deconstruct(Point=pt)  # -> XComponent, YComponent, ZComponent
cull_i = CullIndex(List=chars.Result, Indices=number_slider, Wrap=True)
item = ListItem(List=chars.Result, Index=number_slider, Wrap=True)  # -> flatten(Item)

# ---- group: RH_OUT:vertex_Z
num_2 = Number(pdecon.ZComponent)

# ---- group: RH_OUT:vertex_X
num_3 = Number(pdecon.XComponent)

# ---- group: RH_OUT:vertex_Y
num_4 = Number(pdecon.YComponent)

# ----
join = TextJoin(Text=cull_i)  # -> flatten(Result)

rep = ReplaceText(Text=pt, Find="{", RecursiveReplace=False)
rep_2 = ReplaceText(Text=rep, Find="}", RecursiveReplace=False)

rep_3 = ReplaceText(Text=join, Find="{", RecursiveReplace=False)
rep_4 = ReplaceText(Text=rep_3, Find="}", RecursiveReplace=False)

split = TextSplit(Text=rep_4, Separators=";")

join_2 = TextJoin(Text=split, Join=",")

concat = Concatenate(FragmentA="[", FragmentC=rep_2, FragmentB="]")

concat_2 = Concatenate(FragmentA="[", FragmentC=join_2, FragmentB="]")  # -> flatten(Result)

# ---- group: RH_OUT:mesh_face_type
txt_2 = Text(item)

# ---- group: RH_OUT:mesh_vertex_list
txt_3 = Text(concat)

# ----
rep_5 = ReplaceText(Text=txt_2, Find="T", Replace="triangle", RecursiveReplace=False)

# ---- group: RH_OUT:mesh_face_list
txt_4 = Text(concat_2)

# ----
join_3 = TextJoin(Text=flatten(txt_3), Join=",")

join_4 = TextJoin(Text=flatten(txt_4), Join=",")

rep_6 = ReplaceText(Text=rep_5, Find="Q", Replace="quad", RecursiveReplace=False)

panel = Panel(txt_4)
panel_2 = Panel(txt_3)

concat_3 = Concatenate(FragmentA="[", FragmentC=join_3, FragmentB="]")

concat_4 = Concatenate(FragmentA="[", FragmentC=join_4, FragmentB="]")

panel_3 = Panel(rep_6)
