# Grasshopper definition ex04-16-subd.ghx (Grasshopper 1.0.7)

# ---- group: RH_IN:mesh_res
num = Number(Slider(1, range=0..10))

# ----
box = CenterBox(Base=PlaneXY(0, 0, 0), X=1, Y=1, Z=1)
mbox = MeshBox(Base=box, XCount=num, YCount=num, ZCount=num)

path = FilePath("C:\Compute\Example\ex04-16.3dm")
_3dm = Import3DM(File=path, Layer="*", Name="*")

subdmesh = SubDFromMesh(Mesh=mbox, Creases=1, Corners=1, Interpolate=False)

# ---- group: RH_OUT:subd
geo = Geometry(subdmesh)

# ----
panel = Panel(_3dm)

# ---- group: RH_IN:subd
geo_2 = Geometry(geo)

# ----
meshsubd = MeshFromSubD(SubD=geo_2, Density=2)

# ---- group: RH_OUT:subd_brep
brep = Brep(geo_2)

# ---- group: RH_OUT:subd_mesh
mesh = Mesh(meshsubd)
