# Grasshopper definition ex05.ghx (Grasshopper 1.0.7)

# ^This would create Circle
radus = Slider(100, range=0..100)
# ^The circle would be divided by this length
divlen = Slider(10, range=0..100)

# ---- group: RH_IN:radius
# ^This is how you tell rhino-compute to recognize the variable.
# It can be overrided in rhino-compute-python
num = Number(radus)

# ---- group: RH_IN:divLen
num_2 = Number(divlen)

# ----
cir = Circle(Plane=PlaneXY(0, 0, 0), Radius=num)

# ---- group: RH_IN:circle
crv = Curve(cir)

# ----
divlength = DivideLength(Curve=crv, Length=num_2)  # -> Points, Tangents, Parameters
Z = UnitZ(Factor=Slider(20, range=0..100))
# ^This would create multiple circle from the initial curve's divided points
cir_2 = Circle(Plane=divlength.Points, Radius=Slider(3, range=0..10))
# ^This would create planar surface from given curves
boundary = BoundarySurfaces(Edges=crv)
# ^This would extrude given surface into solid.
# If it's given a curve, it would produce extruded surface without caps
extr = Extrude(Base=boundary, Direction=Z)
# ^ This would convert any Brep(basically any 3d objects with surface)
# into Mesh
mesh = MeshBrep(
    Brep=boundary,
    Settings={GridMaxCount=0, GridMinCount=16, JaggedSeams=False, MaxEdgeLength=0, MinEdgeLength=0.0001, MinTolerance=0, Refine=True, RefineAngle=0, RelativeTolerance=0.65, SimplePlanes=True, Tolerance=0})
# ^This is deconstructing point's x,y,z coordinates
# I couldn't find a way to directly use the point3d geometry in the rhino-compute
pdecon = Deconstruct(Point=divlength.Points)  # -> XComponent, YComponent, ZComponent
# ^This is number of divided points generated
lng = ListLength(List=divlength.Points)

# ---- group: RH_OUT:crvM
crv_2 = Curve(cir_2)

# ---- group: RH_OUT:brep
brep = Brep(extr)

# ---- group: RH_OUT:ptX
num_3 = Number(pdecon.XComponent)

# ---- group: RH_OUT:ptY
num_4 = Number(pdecon.YComponent)

# ---- group: RH_OUT:ptZ
num_5 = Number(pdecon.ZComponent)

# ---- group: RH_OUT:divCount
num_6 = Number(lng)

# ---- group: RH_OUT:srf
srf = Surface(boundary)

# ---- group: RH_OUT:mesh
mesh_2 = Mesh(mesh)

# ----
viewer = ParamViewer(num_3)
viewer_2 = ParamViewer(num_4)
viewer_3 = ParamViewer(num_5)
viewer_4 = ParamViewer(crv_2)
viewer_5 = ParamViewer(num_6)
viewer_6 = ParamViewer(srf)
viewer_7 = ParamViewer(brep)
viewer_8 = ParamViewer(mesh_2)

# ---- group: RH_IN:subDiv
# ^ This would subdivide the small circles into input numbers
num_7 = Number(Slider(4, range=0..10))

# ----
divide = DivideCurve(Curve=crv_2, Count=num_7, Kinks=False)  # -> Points, Tangents, Parameters
number_slider = Slider(1, range=0..10)
cir_3 = Circle(Plane=divide.Points, Radius=Slider(0.5, range=0..1))

# ---- group: RH_OUT:crvTree
crv_3 = Curve(cir_3)

# ----
# ^ This is the address/key to find the nested list of data
viewer_9 = ParamViewer(crv_3)
# ^ You can double click to reveal the tree structure
viewer_10 = ParamViewer(crv_3)
