# Grasshopper definition ex09-01-01.ghx (Grasshopper 1.0.7)
# plug-ins: MetaHopper

groups = GetGroups()  # -> Groups, GroupStyles, Nickname, Color

split = TextSplit(Text=groups.Nickname, Separators=":")
mindex = MemberIndex(Set=split, Member="RH_IN")  # -> Index, Count
lng = ListLength(List=mindex.Index)  # -> flatten(Length)
dispatch = Dispatch(List=groups.Nickname, DispatchPattern=lng)  # -> ListA, ListB

# ---- group: RH_IN:gi_num2
num = Number(Slider(3, range=0..10))

# ---- group: RH_IN:gi_num1
num_2 = Number(Slider(2, range=0..10))

# ----
multiplication = Multiplication(A=num_2, B=num)

# ---- group: RH_OUT:go_q_inputs
txt = Text(dispatch.ListA)

# ---- group: RH_OUT:go_mult
num_3 = Number(multiplication)

# ----
panel = Panel(txt)

# ---- group: RH_IN:gi_mult
num_4 = Number(num_3)

num_5 = Number(num_4)

# ----
pt = Point(Point(0, 0, 0))
rectangle = Rectangle(Plane=pt, XSize=num_5, YSize=num_5, Radius=0)  # -> Rectangle, Length
area = Area(Geometry=rectangle.Rectangle)  # -> Area, Centroid

# ---- group: RH_OUT:go_area
num_6 = Number(area.Area)

# ----
viewer = ParamViewer(num_6)
panel_2 = Panel(num_6)
