# Grasshopper definition ex09-01-01B.ghx (Grasshopper 1.0.7)
# plug-ins: MetaHopper

groups = GetGroups()  # -> Groups, GroupStyles, Nickname, Color

len = TextLength(Text=groups.Nickname)
larger = LargerThan(FirstNumber=len, SecondNumber=Slider(1, range=0..1))  # -> LargerThan, OrEqualTo
dispatch = Dispatch(List=groups.Nickname, DispatchPattern=larger.OrEqualTo)  # -> ListA, ListB

clean = CleanTree(RemoveNulls=True, RemoveInvalid=True, RemoveEmpty=True, Tree=dispatch.ListA)

split = TextSplit(Text=clean, Separators=":")
mindex = MemberIndex(Set=split, Member="RH_IN")  # -> Index, Count
lng = ListLength(List=mindex.Index)  # -> flatten(Length)
dispatch_2 = Dispatch(List=clean, DispatchPattern=lng)  # -> ListA, ListB

split_2 = TextSplit(Text=clean, Separators=":")
mindex_2 = MemberIndex(Set=split_2, Member="RH_OUT")  # -> Index, Count
lng_2 = ListLength(List=mindex_2.Index)  # -> flatten(Length)
dispatch_3 = Dispatch(List=clean, DispatchPattern=lng_2)  # -> ListA, ListB

not = GateNot(A=lng)
not_2 = GateNot(A=lng_2)
and = GateAnd(A=not, B=not_2)
dispatch_4 = Dispatch(List=clean, DispatchPattern=and)  # -> ListA, ListB

tsort = SortText(Keys=dispatch_2.ListA, Values=dispatch_2.ListA, Culture=127)  # -> Keys, Values
tsort_2 = SortText(Keys=dispatch_3.ListA, Values=dispatch_3.ListA, Culture=127)  # -> Keys, Values

# ---- group: RH_OUT:go_q_inputs
txt = Text(tsort.Values)

# ---- group: RH_OUT:go_q_outputs
txt_2 = Text(tsort_2.Values)

# ---- group: RH_OUT:go_q_errors
txt_3 = Text(dispatch_4.ListA)

# ----
mindex_3 = MemberIndex(Set=groups.Nickname, Member=graft(txt))  # -> flatten(Index), Count
item = ListItem(List=groups.Groups, Index=mindex_3.Index, Wrap=True)

swatch = ColourSwatch(SwatchColor=RGB(21, 255, 0))
swatch_2 = ColourSwatch(SwatchColor=RGB(255, 0, 0))

setgroup = SetGroupProperties(Group=item, Color=ColourSwatch(SwatchColor=RGB(0, 191, 255)))
panel = Panel("""RH_IN
RH_IN DUP""")
mindex_4 = MemberIndex(Set=groups.Nickname, Member=graft(txt_2))  # -> flatten(Index), Count
empty = Panel(dispatch.ListB)

cset = CreateSet(List=txt)  # -> Set, Map
lng_3 = ListLength(List=txt)
lng_4 = ListLength(List=cset.Set)
subtraction = Subtraction(A=lng_3, B=lng_4)

larger_2 = LargerThan(FirstNumber=subtraction, SecondNumber=0)  # -> LargerThan, OrEqualTo
item_2 = ListItem(List=groups.Groups, Index=mindex_4.Index, Wrap=True)
filter = StreamFilter(Gate=larger_2.LargerThan, Stream0=swatch, Stream1=swatch_2)
objbynn = GetObjectByNickname(NickName=panel)
mindex_5 = MemberIndex(Set=groups.Nickname, Member=graft(txt_3))  # -> flatten(Index), Count
setgroup_2 = SetGroupProperties(Group=item_2, Color=ColourSwatch(SwatchColor=RGB(255, 0, 85)))
rh_in_dup = Panel(subtraction)
rh_in = Panel(txt)
setpanel = SetPanelProperties(Panel=objbynn, Color=filter)
item_3 = ListItem(List=groups.Groups, Index=mindex_5.Index, Wrap=True)
setgroup_3 = SetGroupProperties(Group=item_3, Color=ColourSwatch(SwatchColor=RGB(255, 251, 0)))
rh_out = Panel(txt_2)

cset_2 = CreateSet(List=txt_2)  # -> Set, Map
lng_5 = ListLength(List=txt_2)
lng_6 = ListLength(List=cset_2.Set)
subtraction_2 = Subtraction(A=lng_5, B=lng_6)

rh_out_dup = Panel(subtraction_2)
panel_2 = Panel("""RH_OUT
RH_OUT DUP""")
larger_3 = LargerThan(FirstNumber=subtraction_2, SecondNumber=0)  # -> LargerThan, OrEqualTo
error = Panel(dispatch_4.ListA)
filter_2 = StreamFilter(Gate=larger_3.LargerThan, Stream0=swatch, Stream1=swatch_2)
objbynn_2 = GetObjectByNickname(NickName=panel_2)
setpanel_2 = SetPanelProperties(Panel=objbynn_2, Color=filter_2)
